# Dynamo custom node usageLog.dyf (Dynamo 2.12.1.8246)
# category: catalyst.telemetry
# node logs every run of the script in which is used to the hardcoded server location

scriptName = Input(scriptName: string)
py_log = Python(IN[0]=scriptName)  # IronPython2
# ---------- py_log.python (34 lines) ----------
# Load the Python Standard and DesignScript Libraries
import sys
import clr
clr.AddReference('ProtoGeometry')
from Autodesk.DesignScript.Geometry import *
clr.AddReference("RevitServices")
import RevitServices
from RevitServices.Persistence import DocumentManager

from datetime import datetime

#import custom library
import sys
sys.path.append(r"\\pantograph\Google_Drive\Public\Firma\Revit\Dynamo\Lib")
import ctypes
from catalyst import dyn_log_path, dyn_logger

# name of the script for log
script_name = IN[0]

doc = DocumentManager.Instance.CurrentDBDocument
app = DocumentManager.Instance.CurrentUIApplication.Application
filePath = doc.PathName

# getting file name from path
lastBackslash = filePath.rindex("\\")+1
file_name = filePath[lastBackslash:]
user_name = app.Username
#user_name = getpass.getuser()

status = dyn_logger(filePath,user_name,script_name)

# Assign your output to the OUT variable.
OUT = status
# ----------------------------------------
OUT = Output(py_log)
