# Dynamo graph 3DtextRoomData_p.dyn (Dynamo 2.12.1.8246)
# packages: Clockwork for Dynamo 2.x 2.4.0, archi-lab.net 2023.213.1523, cata_lyst 0.0.1

# group: INPUT
n3d_text_family = FamilyTypes("3DroomTag:300/120mm")  # "3D Text Family"; graph input
workset_pre_3d_text = WorksetUi("3DtextRoomData")  # graph input

code_block = CodeBlock { "Rooms"; }
byName = Category.ByName(name=code_block)
all_elements_of_category = ElementsOfCategory(Category=byName)
location = Custom[Element.Location+](element=all_elements_of_category)  # package Clockwork for Dynamo 2.x; Returns the location of an element as point, curve or curve loop, along with some booleans to help filtering the results. Unlike the OOTB Element.GetLocation node, it also retunrs sketch lines of sketch-based elements like floor slabs as well as the element's rotation property.

# group: filter only placed rooms
filterByBoolMask = List.FilterByBoolMask(list=all_elements_of_category, mask=location.hasLocation)

level = Custom[Element.Level](element=filterByBoolMask.in)  # package Clockwork for Dynamo 2.x; Gets an element's level
byPointAndLevel = FamilyInstance.ByPointAndLevel(familyType=n3d_text_family, point=location.points, level=level)
written_parameters = CodeBlock()
# ---------- written_parameters.designscript (9 lines) ----------
[
"Number",
"Name",
"Area",
"Floor Finish",
"Wall Finish",
"Ceiling Finish",
"Base Finish"
];
# ----------------------------------------
code_block_2 = CodeBlock(param=written_parameters) { "Room "+param; }
getParameterValueByName = Element.GetParameterValueByName(element=filterByBoolMask.in, parameterName=written_parameters@L2, lacing=Longest)
setParameterByName = Element.SetParameterByName(element=byPointAndLevel, parameterName=code_block_2@L2, value=getParameterValueByName, lacing=Longest)

# group: changing the workset
code_block_3 = CodeBlock { "Workset"; }
id = archilab.Revit.Elements.Workset.Id(workset=workset_pre_3d_text)
setParameterByName_2 = Element.SetParameterByName(element=byPointAndLevel, parameterName=code_block_3, value=id)

návod = StringInput("""V každej Room vytvorí 3D text s uvedením Room Name a Room Number.
Do parametrov 3D text sú zapísané vybrané parametre z Rooms pre jednoduchšiu identifikáciu v 3D pohľadoch alebo mimo Revitu.

Skript funguje s pripravenou family 3DroomTag s pridanými parametrami.

Spusti 2x po sebe!""")  # graph input
code_block_4 = CodeBlock { "3DtextRoomData"; }
usageLog = Custom[usageLog](scriptName=code_block_4)  # package cata_lyst; node logs every run of the script in which is used to the hardcoded server location
