# Dynamo graph Change Type parameters_p.dyn (Dynamo 1.3.1.1736)

# group: INPUT
categories = Categories("Doors")
search_for = StringInput("jednokrídlové")
type_parameter = StringInput("Description")
replace = StringInput("jednokrídl.")

all_elements_of_category = ElementsOfCategory(categories)
type = Custom[Element.Type](element=all_elements_of_category)  # Gets the family type of a given element (if applicable).
uniqueItems = List.UniqueItems(type)
string_from_object = FromObject(uniqueItems)
contains = String.Contains(str=string_from_object, searchFor=search_for)
filterByBoolMask = List.FilterByBoolMask(list=uniqueItems, mask=contains)
getParameterValueByName = Element.GetParameterValueByName(element=filterByBoolMask.in, parameterName=type_parameter)
watch = Watch(getParameterValueByName)
replace_2 = String.Replace(str=getParameterValueByName, searchFor=search_for, replaceWith=replace)
setParameterByName = Element.SetParameterByName(element=filterByBoolMask.in, parameterName=type_parameter, value=replace_2)
návod = StringInput("Nahradí textový reťazec v parametri celej vybranej kategórie")
