# Dynamo graph Copy instance parameter with category filter_p.dyn "Copy instance parameter with category filter" (Dynamo 2.3.0.5885)

# group: INPUT
návod = StringInput("Skopiruje hodnotu parametra z jedneho elementu na druhy. Dovoli vybrat len jednu vybranu Category.")  # graph input
select_model_element = DSModelElementSelection()  # nothing selected; graph input
categories = Categories("OST_Doors")  # graph input
instance_parameter = StringInput("Comments")  # graph input
parameter_value = StringInput("PO")  # graph input

# group: element is of category
getCategory = Element.GetCategory(element=select_model_element)
string_from_object = FromObject(obj=getCategory)
string_from_object_2 = FromObject(obj=categories)
eq = string_from_object == string_from_object_2

filterByBoolMask = List.FilterByBoolMask(list=select_model_element, mask=eq)
setParameterByName = Element.SetParameterByName(element=filterByBoolMask.in, parameterName=instance_parameter, value=parameter_value)

# group: OUTPUT
spracované_elementy = Watch(setParameterByName)  # graph output
