# Dynamo graph CopyAllParameterValues_p.dyn (Dynamo 2.3.0.5885)

# group: INPUT
categories = Categories()  # nothing selected; graph input
original_parameter_name = StringInput("")  # graph input
návod = StringInput("""Skopiruje hodnoty jedneho parametra vsetkych elementov danej kategorie do zvoleneho noveho parametru.

Vhodné napr. pri zmene Project parametru na Shared parameter, pricom do novovytvoreneho paremetra potrebujeme nakopirovat spravne hodnoty povodneho parametra.

Novy parameter uz musi byt vytvoreny.
""")  # graph input
new_parameter_name = StringInput("")  # graph input

all_elements_of_category = ElementsOfCategory(Category=categories)
getParameterValueByName = Element.GetParameterValueByName(element=all_elements_of_category, parameterName=original_parameter_name)
watch = Watch(getParameterValueByName)
setParameterByName = Element.SetParameterByName(element=all_elements_of_category, parameterName=new_parameter_name, value=getParameterValueByName)
count = List.Count(list=setParameterByName)

# group: OUTPUT
počet_prekopírovaných_hodnôt = Watch(count)
