# Dynamo graph Duplicate views_p.dyn (Dynamo 2.0.1.5055)

categories = Categories(index=587)
all_elements_of_category = ElementsOfCategory(Category=categories)

# group: INPUT
parameter_value = StringInput("1")  # graph input
parameter_name = StringInput("Title on Sheet")  # graph input
copied_view_name_suffix = StringInput("floor")  # graph input
new_floor_plan_parameter_name = StringInput("Delenie I")  # graph input
new_floor_plan_parameter_value = StringInput("nove podorysy")  # graph input

getParameterValueByName = Element.GetParameterValueByName(element=all_elements_of_category, parameterName=parameter_name)
eq = parameter_value == getParameterValueByName
filterByBoolMask = List.FilterByBoolMask(list=all_elements_of_category, mask=eq)
duplicate = Custom[View.Duplicate](view=filterByBoolMask.in)  # Duplicates a given view; unwired: name
code_block = CodeBlock { "View Name"; }
getParameterValueByName_2 = Element.GetParameterValueByName(element=duplicate, parameterName=code_block)
watch = Watch(getParameterValueByName_2)
code_block_2 = CodeBlock { "Copy"; }
replace = String.Replace(str=getParameterValueByName_2, searchFor=code_block_2, replaceWith=copied_view_name_suffix)
setParameterByName = Element.SetParameterByName(element=duplicate, parameterName=code_block, value=replace)

# group: copy 1
code_block_3 = CodeBlock { "Copy 1"; }
replace_2 = String.Replace(str=getParameterValueByName_2, searchFor=code_block_3, replaceWith=copied_view_name_suffix)
setParameterByName_2 = Element.SetParameterByName(element=duplicate, parameterName=code_block, value=replace_2)

# group: copy 2
code_block_4 = CodeBlock { "Copy 2"; }
replace_3 = String.Replace(str=getParameterValueByName_2, searchFor=code_block_4, replaceWith=copied_view_name_suffix)
setParameterByName_3 = Element.SetParameterByName(element=duplicate, parameterName=code_block, value=replace_3)

setParameterByName_4 = Element.SetParameterByName(element=duplicate, parameterName=new_floor_plan_parameter_name, value=new_floor_plan_parameter_value)
návod = StringInput("""Skopiruje Views, ktore maju priradeny  parameter s nazvom "Parameter Name" s hodnotou "Parameter Value" ako "Duplicate with detailing" a prida nazvu View priponu "Copied View Name Suffix"

Treba doinstalovat Package Clockwork.""")  # graph input
