# Dynamo graph GroupFinder_p.dyn (Dynamo 2.2.1.5175)

# group: archi-lab
py_get_all_detail_groups = Python()
# ---------- py_get_all_detail_groups.python (35 lines) ----------
#Copyright(c) 2015, Konrad Sobon
# @arch_laboratory, http://archi-lab.net

import clr
clr.AddReference('ProtoGeometry')
from Autodesk.DesignScript.Geometry import *

# Import DocumentManager and TransactionManager
clr.AddReference("RevitServices")
import RevitServices
from RevitServices.Persistence import DocumentManager
from RevitServices.Transactions import TransactionManager

# Import RevitAPI
clr.AddReference("RevitAPI")
import Autodesk
from Autodesk.Revit.DB import *

doc = DocumentManager.Instance.CurrentDBDocument
uiapp = DocumentManager.Instance.CurrentUIApplication
app = uiapp.Application

from System.Collections.Generic import *

#The inputs to this node will be stored as a list in the IN variable.
dataEnteringNode = IN

collector = FilteredElementCollector(doc)
groups = collector.OfCategory(BuiltInCategory.OST_IOSDetailGroups).WhereElementIsNotElementType().ToElements()

groupNames = []
for i in groups:
	groupNames.append(i.Name)

OUT = groupNames, groups
# ----------------------------------------
code_block = CodeBlock(OUT=py_get_all_detail_groups) { OUT[0]; OUT[1]; }

# group: clockwork
py_element_ownerview = Python(IN[0]=code_block.out1)
# ---------- py_element_ownerview.python (16 lines) ----------
import clr
clr.AddReference('RevitAPI')
from Autodesk.Revit.DB import *

clr.AddReference("RevitNodes")
import Revit
clr.ImportExtensions(Revit.Elements)

def GetOwnerView(item):
	if hasattr(item, "OwnerViewId"): return item.Document.GetElement(item.OwnerViewId)
	else: return None

items = UnwrapElement(IN[0])

if isinstance(IN[0], list): OUT = [GetOwnerView(x) for x in items]
else: OUT = GetOwnerView(items)
# ----------------------------------------

list_create = List.Create(item0=code_block.out0, item1=py_element_ownerview)
transpose = List.Transpose(lists=list_create)
detail_group_list = Watch(transpose)  # graph output

# group: INPUT
file_path = Filename("No file selected.")  # graph input
overwrite_schedule = BoolSelector(true)  # graph input

file_from_path = FileObject(path=file_path)
string_from_object = FromObject(obj=file_from_path)
code_block_2 = CodeBlock { "Groups"; 1; 0; }
exportExcel = Data.ExportExcel(filePath=string_from_object, sheetName=code_block_2.out0, startRow=code_block_2.out1, startCol=code_block_2.out2, data=transpose, overWrite=overwrite_schedule)
návod = StringInput("Vytvorí a otvorí exceovskú tabuľku všwtkých Detail Groups a ich Views na, na ktorých sú umiestnené. Pomocou CTRL+F v Project Browseri je potom jednoduché vyhľadať daný View a lokalizovať Detail Groups")  # graph input
