# Dynamo graph Level rename.dyn (Dynamo 0.8.1.1942)

categories = Categories("Levels")
all_elements_of_category = ElementsOfCategory(categories)
uniqueItems = List.UniqueItems(all_elements_of_category)
watch = Watch(uniqueItems)
code_block = CodeBlock { "Name"; }
getParameterValueByName = Element.GetParameterValueByName(element=all_elements_of_category, parameterName=code_block)
uniqueItems_2 = List.UniqueItems(getParameterValueByName)
code_block_2 = CodeBlock { "1.NP"; }
boolean = BoolSelector(true)
startsWith = String.StartsWith(str=uniqueItems_2, searchFor=code_block_2, ignoreCase=boolean)
filterByBoolMask = List.FilterByBoolMask(list=uniqueItems, mask=startsWith)
filterByBoolMask_2 = List.FilterByBoolMask(list=uniqueItems_2, mask=startsWith)

# group: nadzemne poschodia
code_block_3 = CodeBlock { "NP"; }
boolean_2 = BoolSelector(true)
contains = String.Contains(str=filterByBoolMask_2.out, searchFor=code_block_3, ignoreCase=boolean_2)
filterByBoolMask_3 = List.FilterByBoolMask(list=filterByBoolMask.out, mask=contains)
code_block_4 = CodeBlock { 1..33; }
filterByBoolMask_4 = List.FilterByBoolMask(list=filterByBoolMask_2.out, mask=contains)
name_v_tvare_1_poschodie_2_np = CodeBlock(a=code_block_4, b=filterByBoolMask_4.in) { a+".poschodie ("+b+")"; }
setParameterByName = Element.SetParameterByName(element=filterByBoolMask_3.in, parameterName=code_block, value=name_v_tvare_1_poschodie_2_np)

# group: Sutereny
code_block_5 = CodeBlock { "PP"; }
boolean_3 = BoolSelector(true)
contains_2 = String.Contains(str=filterByBoolMask_2.out, searchFor=code_block_5, ignoreCase=boolean_3)
filterByBoolMask_5 = List.FilterByBoolMask(list=filterByBoolMask.out, mask=contains_2)
sort = List.Sort(filterByBoolMask_5.in)
code_block_6 = CodeBlock { 1..33; }
filterByBoolMask_6 = List.FilterByBoolMask(list=filterByBoolMask_2.out, mask=contains_2)
sort_2 = List.Sort(filterByBoolMask_6.in)
name_v_tvare_1_suterén_1_pp = CodeBlock(a=code_block_6, b=sort_2) { a+".suterén ("+b+")"; }
setParameterByName_2 = Element.SetParameterByName(element=sort, parameterName=code_block, value=name_v_tvare_1_suterén_1_pp)

filterByBoolMask_7 = List.FilterByBoolMask(list=all_elements_of_category, mask=startsWith)

# group: prizemie
code_block_7 = CodeBlock { "prízemie"; }
setParameterByName_3 = Element.SetParameterByName(element=filterByBoolMask_7.in, parameterName=code_block, value=code_block_7)
