# Dynamo graph Parameter Replace_p.dyn (Dynamo 1.3.1.1736)

návod = StringInput("""vyhlada textovy retazec v parametri zvolenej category a nahradi ho za zvoleny text.
napriklad premenuje vsetky rezy""")

# group: INPUT
element_types = ElementTypes("ViewSection")
parameter_name_always_case = StringInput("View Name")  # "Parameter name (always Case Sensitive)"
search = StringInput("Section")
ignore_case = BoolSelector(true)
replace_for = StringInput("Rez")

all_elements_of_type = ElementsOfType(element_types)
getParameterValueByName = Element.GetParameterValueByName(element=all_elements_of_type, parameterName=parameter_name_always_case)
contains = String.Contains(str=getParameterValueByName, searchFor=search, ignoreCase=ignore_case)
filterByBoolMask = List.FilterByBoolMask(list=all_elements_of_type, mask=contains)
watch = Watch(filterByBoolMask.in)
filterByBoolMask_2 = List.FilterByBoolMask(list=getParameterValueByName, mask=contains)
replace = String.Replace(str=filterByBoolMask_2.in, searchFor=search, replaceWith=replace_for)
setParameterByName = Element.SetParameterByName(element=watch, parameterName=parameter_name_always_case, value=replace)
status = Watch(setParameterByName)
