# Dynamo graph Room centre.dyn (Dynamo 1.3.2.2480)

levels = Levels()
all_elements_at_level = ElementsAtLevel(levels)
room_location_centering = Custom[Room Location Centering](Rooms=all_elements_at_level@L1)  # Move room location point to its centroid. If centroid is located outside the room, location point stays at its origin coords. It's a good tool for auto-tagging.
