# Dynamo graph Room renumbering - filter and prefix_p.dyn (Dynamo 2.3.0.5885)

code_block = CodeBlock { "Rooms"; }
byName = Category.ByName(name=code_block)
all_elements_of_category = ElementsOfCategory(Category=byName)
code_block_2 = CodeBlock { "Name"; }
getParameterValueByName = Element.GetParameterValueByName(element=all_elements_of_category, parameterName=code_block_2)

# group: INPUT
room_name_starts_with = StringInput("Kobka")  # graph input
prefix = StringInput("k.")  # graph input

startsWith = String.StartsWith(str=getParameterValueByName, searchFor=room_name_starts_with)
filterByBoolMask = List.FilterByBoolMask(list=all_elements_of_category, mask=startsWith)
string = StringInput("Number")
count = List.Count(list=filterByBoolMask.in)
code_block_3 = CodeBlock(x=count) { 1..x; }

# group: 0 nvyse pri jednocifernych cislach
number = DoubleInput(10)
lt = code_block_3 < number
code_block_4 = CodeBlock { "0"; }
code_block_5 = CodeBlock { ""; }
if_ = If(test=lt, true=code_block_4, false=code_block_5)

code_block_6 = CodeBlock(a=prefix, b=if_, c=code_block_3) { a+b+c; }
string_from_object = FromObject(obj=code_block_6)
setParameterByName = Element.SetParameterByName(element=filterByBoolMask.in, parameterName=string, value=string_from_object)
count_2 = List.Count(list=setParameterByName)
počet_prečíslovaných_miestností = Watch(count_2)
návod = StringInput("ocisluje vsetky miestnosti, ktorych nazov zacina tak ako hodnota v \"Room name search\" a prida predponu (prefix)")  # graph input
