# Dynamo graph Room renumbering spline-byty_p.dyn (Dynamo 2.3.0.5885)

code_block = CodeBlock { "Rooms"; }
byName = Category.ByName(name=code_block)
all_elements_of_category = ElementsOfCategory(Category=byName)
watch = Watch(all_elements_of_category)
filterByBoolMask = List.FilterByBoolMask(list=all_elements_of_category)  # unwired: mask
watch_2 = Watch(filterByBoolMask.in)

# group: INPUT
select_model_line = DSModelElementSelection()  # 1 picked in the model; graph input
code_block_2 = CodeBlock { 1000; }
prefix = StringInput("")  # graph input
number_of_level = DoubleInput(2)  # graph input
cislo_bytu = DoubleInput(12)  # graph input
start_number = DoubleInput(1)  # graph input

# note: chyba v tomto node, znamena ze ciara nie je nakreslena ako MODEL LINE
curve = CurveElement.Curve(curveElement=select_model_line)
# note: chyba v tomto node znamena ze ciara je prilis dlha
pointsAtChordLengthFromPoint = Curve.PointsAtChordLengthFromPoint(curve=curve, chordLength=code_block_2)
splitByPoints = Curve.SplitByPoints(curve=curve, points=pointsAtChordLengthFromPoint)
endPoint = Curve.EndPoint(curve=splitByPoints)
geometry = Element.Geometry(element=all_elements_of_category)
boundingBox = Geometry.BoundingBox(geometry=geometry)
flatten = List.Flatten(list=boundingBox)
contains = BoundingBox.Contains(boundingBox=flatten)  # unwired: point
map = List.Map(list=endPoint, f_x=contains)
map_2 = List.Map(list=map, f_x=filterByBoolMask.in)
flatten_2 = List.Flatten(list=map_2)
uniqueItems = List.UniqueItems(list=flatten_2)
watch_3 = Watch(uniqueItems)
string = StringInput("Number")
code_block_3 = CodeBlock { "."; }

# group: 0 navyse pri jednocifernych cislach
number = DoubleInput(10)
lt = cislo_bytu < number
number_2 = DoubleInput(0)
code_block_4 = CodeBlock { ""; }
if_ = If(test=lt, true=number_2, false=code_block_4)

count = List.Count(list=watch_3)
number_3 = DoubleInput(1)
sequence = Sequence(start=start_number, amount=count, step=number_3, lacing=Longest)
string_from_object = FromObject(obj=sequence)
toNumber = String.ToNumber(str=string_from_object)

# group: 0 navyse pri jednocifernych cislach
number_4 = DoubleInput(10)
lt_2 = toNumber < number_4
number_5 = DoubleInput(0)
code_block_5 = CodeBlock { ""; }
if_2 = If(test=lt_2, true=number_5, false=code_block_5)

code_block_6 = CodeBlock(pref=prefix, lev=number_of_level, dot=code_block_3, zer1=if_, flat=cislo_bytu, zer2=if_2, room=string_from_object) { pref+lev+dot+zer1+flat+zer2+room; }
setParameterByName = Element.SetParameterByName(element=watch_3, parameterName=string, value=code_block_6)
count_2 = List.Count(list=setParameterByName)
počet_prečísovaných_miestností = Watch(count_2)
# note: Precisluje miestnosti podla nakreslenej ciary.
# Najprv je potrebne nakreslit ciaru (najlepsie spline), ktora pretina miestnosti ktore chceme precislovat. Ciary je dobre robit v samostatnej Subcategory napr. "Renumbering rooms" aby sa dali lahko vsetky naraz vypnut/zapnut pre nasledne opatovne precislovanie. Ciara musi byt kreslena ako Model Line alebo convertovana z Detail Line.
# Model Line musi byt nakreslena vo Workplane, ktora pretina precislovane miestnost, cize typicky v rovine podlahy. Pri velmi dlhej ciare sa moze vyskytnut chyba, vtedy rozdelte ciaru na viacere elementy.
# Prikaz moze pracovat dlhsie, nepustajte ho v automatickom mode, ale len v manualnom.
návod = StringInput("""Format precislovania = pl.bbmm
p=prefix, l=level, b=cislo bytu, m=cislo miestnosti
napr. = A12.0105

Precisluje miestnosti podla nakreslenej ciary.
	Najprv je potrebne nakreslit ciaru (najlepsie spline), ktora pretina miestnosti ktore chceme precislovat. Ciary je dobre robit v samostatnej Subcategory napr. "Renumbering rooms" aby sa dali lahko vsetky naraz vypnut/zapnut pre nasledne opatovne precislovanie. Ciara musi byt kreslena ako Model Line alebo convertovana z Detail Line.
	Model Line musi byt nakreslena vo Workplane, ktora pretina precislovane miestnost, cize typicky v rovine podlahy. Pri velmi dlhej ciare sa moze vyskytnut chyba, vtedy rozdelte ciaru na viacere elementy.
	Prikaz moze pracovat dlhsie, nepustajte ho v automatickom mode, ale len v manualnom.""")  # graph input
