# Dynamo graph SUM of selected element Areas_p.dyn (Dynamo 2.0.1.5055)

# group: INPUT
# note: Spocita plochu vsetkych vybranych elementov.
# Elementy je nutne vybrat naraz cez Cross Window. Podporovane su vsetky elementy ktore maju parameter s nazvom Area (Rooms, Floors, Walls...)
vyberte_elementy_oknom = DSModelElementsSelection()  # nothing selected; graph input

count = List.Count(list=vyberte_elementy_oknom)
počet_elementov = Watch(count)  # graph output
code_block = CodeBlock { "Area"; }
getParameterValueByName = Element.GetParameterValueByName(element=vyberte_elementy_oknom, parameterName=code_block)
sum = Math.Sum(values=getParameterValueByName)
code_block_2 = CodeBlock { 3; }
round = Math.Round(number=sum, digits=code_block_2)
plocha_v_m2 = Watch(round)  # graph output
návod = StringInput("""Spocita plochu vsetkych vybranych elementov.
Elementy je nutne vybrat naraz cez Cross Window. Podporovane su vsetky elementy ktore maju parameter s nazvom Area (Rooms, Floors, Walls...)""")  # graph input
