# Dynamo graph SUM of selected element Length_p.dyn (Dynamo 1.3.1.1736)

# group: INPUT
# note: Spocita dlzku jednotlivych elementov.
# Elementy je potrebne vybrat cez Crossing Window. Podporovane su vsetky elementy, ktore maju parameter Length (Railings, Walls, Lines...)
vyberte_elementy_oknom = DSModelElementsSelection()

count = Count(vyberte_elementy_oknom)
počet_elementov = Watch(count)
code_block = CodeBlock { "Length"; }
getParameterValueByName = Element.GetParameterValueByName(element=vyberte_elementy_oknom, parameterName=code_block)
sum = Math.Sum(getParameterValueByName)
code_block_2 = CodeBlock { 2; }
round = Math.Round(number=sum, digits=code_block_2)
dlzka_v_mm = Watch(round)
code_block_3 = CodeBlock(a=dlzka_v_mm) { a/1000; }
dlzka_v_m = Watch(code_block_3)
návod = StringInput("""Spocita dlzku jednotlivych elementov.
Elementy je potrebne vybrat cez Crossing Window. Podporovane su vsetky elementy, ktore maju parameter Length (Railings, Walls, Lines...)""")
