# Dynamo graph SUM of selected element Volume_p.dyn (Dynamo 1.3.1.1736)

# group: INPUT
# note: Spocita objem jednotlivych elementov.
# Elementy je potrebne vybrat cez Crossing Window. Podporovane su vsetky elementy, ktore maju parameter Volume (Walls, Floors, Columns, Slab Edges...)
vyberte_elementy_oknom = DSModelElementsSelection()

count = Count(vyberte_elementy_oknom)
počet_elementov = Watch(count)
code_block = CodeBlock { "Volume"; }
getParameterValueByName = Element.GetParameterValueByName(element=vyberte_elementy_oknom, parameterName=code_block)
sum = Math.Sum(getParameterValueByName)
code_block_2 = CodeBlock { 3; }
round = Math.Round(number=sum, digits=code_block_2)
objem_v_m3 = Watch(round)
code_block_3 = CodeBlock(a=sum) { a*1000; }
round_2 = Math.Round(number=code_block_3, digits=code_block_2)
objem_v_litroch = Watch(round_2)
návod = StringInput("""Spocita objem jednotlivych elementov.
Elementy je potrebne vybrat cez Crossing Window. Podporovane su vsetky elementy, ktore maju parameter Volume (Walls, Floors, Columns, Slab Edges...)""")
