# Dynamo graph SchodyPodchodnaVyska_p.dyn (Dynamo 1.3.1.1736)

návod = StringInput("Vypočíta podchodnú a priechodnú výšku vybraného schodiska podľa STN 73 4130 ")

# group: INPUT
select_stairs = DSModelElementSelection()  # 1 picked in the model

code_block = CodeBlock { "Actual Riser Height"; }
getParameterValueByName = Element.GetParameterValueByName(element=select_stairs, parameterName=code_block)
code_block_2 = CodeBlock { "Actual Tread Depth"; }
getParameterValueByName_2 = Element.GetParameterValueByName(element=select_stairs, parameterName=code_block_2)
angle_of_staircase_run = CodeBlock(height=getParameterValueByName, depth=getParameterValueByName_2) { Math.Atan(height/depth); }
code_block_3 = CodeBlock { 1; }
round = Math.Round(number=angle_of_staircase_run, digits=code_block_3)
code_block_4 = CodeBlock(angle=angle_of_staircase_run) { 750+1500*Math.Cos(angle); }
round_2 = Math.Round(code_block_4)
code_block_5 = CodeBlock(angle=angle_of_staircase_run) { 1500+(750/Math.Cos(angle)); }
round_3 = Math.Round(code_block_5)

# group: claims
code_block_6 = CodeBlock(a=round) { "príliš strmé schodisko "+a+" - nevyhovuje ako hlavné schodisko - z.532 §27 bod 4"; }
code_block_7 = CodeBlock(a=round_2) { a+" - nevyhovuje bodu 23 STN 73 4130"; }
code_block_8 = CodeBlock(b=round_3, a=getParameterValueByName) { b+" - príliš veľká výška stupňa "+a+" - nevyhovuje"; }

code_block_9 = CodeBlock(x=round, y=code_block_6, z=round) { ((x>35)?y:z); }
sklon_schodiskového_ramena = Watch(code_block_9)
code_block_10 = CodeBlock(x=round_2, y=code_block_7, z=round_2) { ((x<1900)?y:z); }
najmenšia_priechodná_výška_v_mm = Watch(code_block_10)
code_block_11 = CodeBlock(x=getParameterValueByName, y=code_block_8, z=round_3) { ((x>180)?y:z); }
najmenšia_podchodná_výška_mm = Watch(code_block_11)
