# Dynamo graph WarningColorSelect_po.dyn "WarningColorSelect" (Dynamo 2.2.1.5175)

# group: from archilab package
getWarnings = archilab.Revit.Elements.Warning.GetWarnings()
elements = archilab.Revit.Elements.Warning.Elements(warning=getWarnings)

flatten = List.Flatten(list=elements)

# group: from archilab package
clear_list = Custom[Clear List](input=flatten)  # This node will remove all Null and Empty Lists from any list.
id = archilab.Revit.Elements.WarningElement.Id(warningElement=clear_list)

flatten_2 = List.Flatten(list=id)
py_select_elements = Python(IN[0]=flatten_2)
# ---------- py_select_elements.python (29 lines) ----------
import clr
clr.AddReference("RevitAPI")
import Autodesk
from Autodesk.Revit.DB import ElementId
clr.AddReference("RevitServices")
import RevitServices
from RevitServices.Persistence import DocumentManager
clr.AddReference("System")
from System.Collections.Generic import List

uiapp = DocumentManager.Instance.CurrentUIApplication

ids = IN[0]

# if it's not a list, make it a list
if not isinstance(ids, list):
	ids = [ids]

# convert to element ids
elemIds = []
for id in ids:
    elemIds.append(ElementId(id))
    

# cast to icollection and select
uiapp.ActiveUIDocument.Selection.SetElementIds(List[ElementId](elemIds));

#Assign your output to the OUT variable.
OUT = 0
# ----------------------------------------
byElementId = archilab.Revit.Selection.Select.ByElementId(id=flatten_2)

# group: INPUT
color_palette = ColorPalette({R: 255, G: 20, B: 147, A: 255})

overrideColorInView = Element.OverrideColorInView(element=byElementId, color=color_palette)
