# Dynamo graph automaticke preklady_p.dyn (Dynamo 1.3.1.1736)

categories = Categories("Doors")
all_elements_of_category = ElementsOfCategory(categories)
type = Custom[Element.Type](element=all_elements_of_category)  # Gets the family type of a given element (if applicable).
code_block = CodeBlock { "Type Mark"; }
parameterByName = Parameter.ParameterByName(element=type, name=code_block)
string_from_object = FromObject(parameterByName)
nedávať_preklad_na_dvere_s_type = StringInput("xxx")  # "Nedávať preklad na dvere s Type Mark:"
contains = String.Contains(str=string_from_object, searchFor=nedávať_preklad_na_dvere_s_type)
filterByBoolMask = List.FilterByBoolMask(list=all_elements_of_category, mask=contains)
host = Custom[Element.Host](element=filterByBoolMask.out)  # Gets an element's host
type_2 = Custom[Element.Type](element=host)
parameter_name = StringInput("Type Comments")
parameterByName_2 = Parameter.ParameterByName(element=type_2, name=parameter_name)
string_from_object_2 = FromObject(parameterByName_2)
parameter_value = StringInput("murované steny")
contains_2 = String.Contains(str=string_from_object_2, searchFor=parameter_value)
filterByBoolMask_2 = List.FilterByBoolMask(list=filterByBoolMask.out, mask=contains_2)
code_block_2 = CodeBlock { "nosny preklad"; }
boolean = BoolSelector(true)
setParameterByName = Element.SetParameterByName(element=filterByBoolMask_2.in, parameterName=code_block_2, value=boolean)
boolean_2 = BoolSelector(false)
setParameterByName_2 = Element.SetParameterByName(element=filterByBoolMask_2.out, parameterName=code_block_2, value=boolean_2)
návod = StringInput("""Vsetkym dveram v projekte v nenosnych stenach prida preklady. Je mozne nastavit vynimku. Funguje len s dverami, v ktorych visibility prekladu ovlada parameter "nosný preklad"
 Ak su dvere v stene, ktora ma parameter rovny nastavenej hodnote, nastaví parameter dverí "nosný preklad" na YES a naopak
 napr. IF Type Comments == "murovane steny" => "nosný preklad"=YES""")
