# Dynamo graph beamsFromGridsIntersects.dyn (Dynamo 2.12.1.8246)

# group: INPUT
select_face = DSFaceSelection()  # 1 picked in the model
select_grids = DSModelElementsSelection()  # 15 picked in the model
levels = Levels("2.NP")
structural_framing_types = StructuralFramingTypes("Family1")

curve = Grid.Curve(grid=select_grids)
code_block = CodeBlock { 50000; }
byCoordinates = Vector.ByCoordinates(z=code_block)
extrude = Curve.Extrude(curve=curve, direction=byCoordinates)
intersect = Geometry.Intersect(geometry=select_face, other=extrude, lacing=Longest)
flatten = List.Flatten(list=intersect)
beamByCurve = StructuralFraming.BeamByCurve(curve=flatten, level=levels, structuralFramingType=structural_framing_types)
code_block_2 = CodeBlock { "Cross-Section Rotation"; 0; }
setParameterByName = Element.SetParameterByName(element=beamByCurve, parameterName=code_block_2.out0, value=code_block_2.out1)
