# Dynamo graph checkUnhostedElements_p.dyn (Dynamo 2.0.1.5055)

select_model_elements = DSModelElementsSelection()  # nothing selected; graph input
string = StringInput("Host")
getParameterValueByName = Element.GetParameterValueByName(element=select_model_elements, parameterName=string)
uniqueItems = List.UniqueItems(list=getParameterValueByName)
názvy_elementov_ktoré_sú_ako = Watch(uniqueItems)  # "Názvy elementov, ktoré sú ako host"; graph output
návod = StringInput("""Vypíše elementy, ku ktorým sú hostované označené elementy.

Vhodné napr. na kontrolu či sú všetky stromy hostované k Topography atd.""")  # graph input
