# Dynamo graph sheetCreateTXT.dyn (Dynamo 2.12.1.8246)
# packages: Rhythm 2022.4.3, cata_lyst 0.0.1

manual = StringInput("""Vytvorí Sheety s číslami a názvami výkresov podľa excelovskej tabuľky.
Na každý Sheet pridá Floor Plan s názvom podľa 3. stĺpca.

V projekte nemôžu byť 2 rovnako nazvané Floor Plany ak jeden z nich chceme automaticky umiestňovať na Sheet.

Formát XLS súboru:
1. stĺpec - Sheet Number
2. stĺpec - Sheet Name
3. Stĺpec - View Name 1
4. Stĺpec - View Name 2 (nepovinné)""")  # graph input

# group: INPUT
file_path_for_excel_schedule = Filename("sheetcreate\sheetlist_B1.txt")  # graph input

fromPath = FileObject(path=file_path_for_excel_schedule)  # "File.FromPath"
readText = FileSystem.ReadText(file=fromPath)

# group: FIX it here
python_script = Python(IN[0]=readText)  # IronPython2
# ---------- python_script.python (16 lines) ----------
# Load the Python Standard and DesignScript Libraries
import sys
import clr
clr.AddReference('ProtoGeometry')
from Autodesk.DesignScript.Geometry import *

# The inputs to this node will be stored as a list in the IN variables.
text = IN[0]
structured = []
# Place your code below this line
t = text.split("\n")
for i in t:
	line = i.split("	")
	structured.append(line)
# Assign your output to the OUT variable.
OUT = structured
# ----------------------------------------

transpose = List.Transpose(lists=python_script)
number = DoubleInput(1)
getItemAtIndex = List.GetItemAtIndex(list=transpose, index=number)
watch = Watch(getItemAtIndex)
number_2 = DoubleInput(0)
getItemAtIndex_2 = List.GetItemAtIndex(list=transpose, index=number_2)
watch_2 = Watch(getItemAtIndex_2)

# group: INPUT
select_title_block = FamilyTypes("SHT_DUR_A&A_Výkresy:297X420")  # graph input

categories = Categories("OST_Views")
all_elements_of_category = ElementsOfCategory(Category=categories)

# group: list of View Categories
code_block = CodeBlock()
# ---------- code_block.designscript (8 lines) ----------
["Revit.Elements.Views.FloorPlanView",
"Revit.Elements.Views.SectionView",
"Revit.Elements.Views.CeilingPlanView",
"Revit.Elements.Views.Legend",
"Revit.Elements.Views.AxonometricView",
"Revit.Elements.Views.AreaPlanView",
"Revit.Elements.Views.DraftingView",
"Revit.Elements.Views.ScheduleView"];
# ----------------------------------------

select_view_type_of_1st_view_1 = DoubleSlider(1, range=1..7 step 1)  # "Select View Type of 1st View 1 - FloorPlanView 2 - SectionView 3 - CeilingPlanView 4 - Legend 5 - AxonometricView 6 - AreaPlanView 7 - DraftingView"; graph input

# group: Filter - just selected View Category
type = Object.Type(object=all_elements_of_category)
code_block_2 = CodeBlock(list=code_block, x=select_view_type_of_1st_view_1) { list[x-1]; }
eq = type == code_block_2
filterByBoolMask = List.FilterByBoolMask(list=all_elements_of_category, mask=eq)

code_block_3 = CodeBlock { "View Name"; }
getParameterValueByName = Element.GetParameterValueByName(element=filterByBoolMask.in, parameterName=code_block_3)
number_3 = DoubleInput(2)
getItemAtIndex_3 = List.GetItemAtIndex(list=transpose, index=number_3)
watch_3 = Watch(getItemAtIndex_3)

# group: removing nulls
code_block_4 = CodeBlock { 0; }
string_from_object = FromObject(obj=watch_3)
code_block_5 = CodeBlock { "null"; }
allIndicesOf = List.AllIndicesOf(list=string_from_object, item=code_block_5)
firstItem = List.FirstItem(list=allIndicesOf)
slice = List.Slice(list=watch_3, start=code_block_4, end=firstItem)

allIndicesOf_2 = List.AllIndicesOf(list=getParameterValueByName, item=slice)
flatten = List.Flatten(list=allIndicesOf_2)
getItemAtIndex_4 = List.GetItemAtIndex(list=filterByBoolMask.in, index=flatten)

# group: possible list create with 2nd views
list_create = List.Create(item0=getItemAtIndex_4)

transpose_2 = List.Transpose(lists=list_create)
code_block_6 = CodeBlock { Point.ByCoordinates(1970,830,0); }
byNameNumberTitleBlockViewsAndLocations = Sheet.ByNameNumberTitleBlockViewsAndLocations(sheetName=watch, sheetNumber=watch_2, titleBlockFamilyType=select_title_block, views=transpose_2, locations=code_block_6)
count = List.Count(list=byNameNumberTitleBlockViewsAndLocations)
code_block_7 = CodeBlock(count=count) { "Bolo vytvorenych " + count + " Sheetov."; }
status = Watch(code_block_7)  # graph output
sheets = Watch(byNameNumberTitleBlockViewsAndLocations)  # graph output
manual_2 = StringInput("""1 - FloorPlanView
2 - SectionView
3 - CeilingPlanView
4 - Legend
5 - AxonometricView
6 - AreaPlanView
7 - DraftingView""")
categories_2 = Categories("OST_Views")
all_elements_of_category_2 = ElementsOfCategory(Category=categories_2)
categories_3 = Categories("OST_Schedules")
all_elements_of_category_3 = ElementsOfCategory(Category=categories_3)
join = List.Join(list0=all_elements_of_category_2, list1=all_elements_of_category_3)
select_view_type_of_2nd_view = DoubleSlider(8, range=1..8 step 1)  # "Select View Type of 2nd View (optional)"; graph input

# group: Filter - just selected View Category
type_2 = Object.Type(object=join)
code_block_8 = CodeBlock(list=code_block, x=select_view_type_of_2nd_view) { list[x-1]; }
eq_2 = type_2 == code_block_8
filterByBoolMask_2 = List.FilterByBoolMask(list=join, mask=eq_2)

code_block_9 = CodeBlock { "View Name"; }
getParameterValueByName_2 = Element.GetParameterValueByName(element=filterByBoolMask_2.in, parameterName=code_block_9)
number_4 = DoubleInput(3)
getItemAtIndex_5 = List.GetItemAtIndex(list=transpose, index=number_4)
watch_4 = Watch(getItemAtIndex_5)

# group: FIX THIS
adhoc_return_remover = Python(IN[0]=watch_4)  # IronPython2
# ---------- adhoc_return_remover.python (17 lines) ----------
# Load the Python Standard and DesignScript Libraries
import sys
import clr
clr.AddReference('ProtoGeometry')
from Autodesk.DesignScript.Geometry import *

# The inputs to this node will be stored as a list in the IN variables.
data = IN[0]
output = []
# Place your code below this line
for i in data:
	try:
		output.append(i[:-1])
	except:
		pass
# Assign your output to the OUT variable.
OUT = output
# ----------------------------------------

# group: removing nulls
code_block_10 = CodeBlock { 0; }
string_from_object_2 = FromObject(obj=adhoc_return_remover)
code_block_11 = CodeBlock { "null"; }
allIndicesOf_3 = List.AllIndicesOf(list=string_from_object_2, item=code_block_11)
firstItem_2 = List.FirstItem(list=allIndicesOf_3)
slice_2 = List.Slice(list=adhoc_return_remover, start=code_block_10, end=firstItem_2)

allIndicesOf_4 = List.AllIndicesOf(list=getParameterValueByName_2, item=slice_2)
flatten_2 = List.Flatten(list=allIndicesOf_4)
getItemAtIndex_6 = List.GetItemAtIndex(list=filterByBoolMask_2.in, index=flatten_2)
code_block_12 = CodeBlock { Point.ByCoordinates(2090,930,0); }
ʳʰʸᵗʰᵐ_viewport_create = Rhythm.Revit.Elements.Viewport.Create(sheet=byNameNumberTitleBlockViewsAndLocations, view=getItemAtIndex_6, location=code_block_12)
adhoc_return_remover_2 = Python(IN[0]=watch_3)  # IronPython2; same code as adhoc_return_remover
code_block_13 = CodeBlock { "sheetCreateTXT"; }
usageLog = Custom[usageLog](scriptName=code_block_13)  # package cata_lyst; node logs every run of the script in which is used to the hardcoded server location
