# Dynamo graph floorOnTopo_p.dyn (Dynamo 1.3.2.2480)

# group: INPUT
select_topography = DSModelElementSelection()
select_floor_to_match_topography = DSModelElementSelection()
offset = DoubleSlider(45, range=0..100 step 5)

mesh = Topography.Mesh(select_topography)
toPolySurface = Custom[Springs.Mesh.ToPolySurface](mesh=mesh)  # Converts a Dynamo mesh to a polysurface. Uses multithreading - optimized for 4 cores.

# group: sketch lines collector
boolean = BoolSelector(true)
elementSketch = Custom[Springs.Collector.ElementSketch](element=select_floor_to_match_topography, fetchModelCurves=boolean)  # Get the actual sketch lines of a sketch based element (floor, ceiling, modified wall, etc.) . You can optionally fetch the matching model curves, however this might prove comptationally heavy on larger data sets.
curve = CurveElement.Curve(elementSketch.model_curves)
endPoint = Curve.EndPoint(curve)
startPoint = Curve.StartPoint(curve)
create = List.Create(endPoint, startPoint)
flatten = Flatten(create)
uniqueItems = List.UniqueItems(flatten)

# group: get max height of topography
faceVertices = Custom[Mesh.FaceVertices](mesh=mesh)  # Gets the vertices of each face of a given mesh
X = Point.X(faceVertices)

flatten_2 = Flatten(X)

# group (continued): get max height of topography
maximumItem = List.MaximumItem(flatten_2)

# group: vertical lines to intersect
X_2 = Point.X(uniqueItems)
Y = Point.Y(uniqueItems)
code_block = CodeBlock(maxheight=maximumItem) { maxheight; -1*maxheight; }
byCoordinates = Point.ByCoordinates(x=X_2, y=Y, z=code_block.maxheight)
byCoordinates_2 = Point.ByCoordinates(x=X_2, y=Y, z=code_block.out1)
byStartPointEndPoint = Line.ByStartPointEndPoint(startPoint=byCoordinates, endPoint=byCoordinates_2)

flatten_3 = Flatten(byStartPointEndPoint)
intersect = Geometry.Intersect(geometry=toPolySurface, other=flatten_3)
flatten_4 = Flatten(intersect)
clear_list = Custom[Clear List](Input=flatten_4)  # This node will remove all Null and Empty Lists from any list.
points = Topography.Points(select_topography)
join = List.Join(clear_list, points)

# group: floor Z-axis elevation
X_3 = Point.X(join)
Y_2 = Point.Y(join)
Z = Point.Z(join)
code_block_2 = CodeBlock(a=Z, offset=offset) { a+offset; }
byCoordinates_3 = Point.ByCoordinates(x=X_3, y=Y_2, z=code_block_2)

slabShapeByPoints = Custom[Floor.SlabShapeByPoints](points=byCoordinates_3, floor=select_floor_to_match_topography)  # Transform a slab shape based on a list of Points
points_of_floor_sketch = Watch(clear_list)
návod = StringInput("""Prispôsobí tvar Floor tvaru Topography. Je možné určiť offset od Topography

Je potrebné mať nainštalovaný package Springs.""")
