# Dynamo graph numberingElements_p.dyn "numberingElements" (Dynamo 2.3.0.5885)

# group: INPUT
select_model_elements = DSModelElementsSelection()  # 4 picked in the model; graph input
parameter_name = StringInput("Mark")  # graph input
prefix = StringInput("OMP")  # graph input
starting_number = DoubleInput(1)  # graph input

getLocation = Element.GetLocation(element=select_model_elements)
Y = Point.Y(point=getLocation)
code_block = CodeBlock { "Mark"; }
X = Point.X(point=getLocation)
sort = List.Sort(list=X)
indexOf = List.IndexOf(list=X, element=sort)
getItemAtIndex = List.GetItemAtIndex(list=select_model_elements, index=indexOf)
count = List.Count(list=getItemAtIndex)
code_block_2 = CodeBlock(start=starting_number, x=count) { start..(start+x); }

# group: 0 navyse pri dvojcifernych cislach
code_block_3 = CodeBlock { 100.000; }
lt = code_block_2 < code_block_3
number = DoubleInput(0)
code_block_4 = CodeBlock { ""; }
if_ = If(test=lt, true=number, false=code_block_4)

# group: 0 navyse pri jednocifernych cislach
number_2 = DoubleInput(10)
lt_2 = code_block_2 < number_2
number_3 = DoubleInput(0)
code_block_5 = CodeBlock { ""; }
if_2 = If(test=lt_2, true=number_3, false=code_block_5)

string_from_object = FromObject(obj=code_block_2)
code_block_6 = CodeBlock(x=prefix, ba=if_, c=if_2, d=string_from_object) { x+ba+c+d; }
setParameterByName = Element.SetParameterByName(element=getItemAtIndex, parameterName=parameter_name, value=code_block_6)
Z = Point.Z(point=getLocation)
návod = StringInput("""Prečísluje elementy na základe ich polohy. Po poradí zoradí elementy podľa ich X-ovej súradnice a prečísluje ich podľa formátu:
"pddd"
p - prefix
d - digit (číslo)

(napr. OML001, OML002...)""")  # graph input
