# Dynamo graph parking space count by room_p.dyn (Dynamo 1.3.1.1736)

# group: INPUT
select_model_element_room = DSModelElementSelection()
# note: Spocita parkovacie miesta vo vybranej miestnosti a zapise ho do shared parametru.
room_parameter_tag = StringInput("Comments")
categories = Categories("Parking")

boundingBox = Geometry.BoundingBox(select_model_element_room)
all_elements_of_category = ElementsOfCategory(categories)
location = Custom[Element.Location](element=all_elements_of_category)  # Returns the location of an element as an XYZ (or if it's line-based the start and end point of the line), along with some booleans to help filtering the results. Use this for some element types (e.g. walls or lines) that do not work with the built-in Get Family Instance Location node.
contains = BoundingBox.Contains(boundingBox, location.points)
countTrue = CountTrue(contains)
string_from_object = FromObject(countTrue)
setParameterByName = Element.SetParameterByName(element=select_model_element_room, parameterName=room_parameter_tag, value=string_from_object)
watch = Watch(countTrue)
návod = StringInput("Spocita parkovacie miesta vo vybranej miestnosti a zapise ho do vybraneho parametru miestnosti.")
