# Dynamo graph plantingRandomRotate_p.dyn (Dynamo 2.3.0.5885)

# group: INPUT
categories = Categories("OST_Planting")  # graph input
filter_by_parameter = StringInput("Comments")  # graph input
filter_parameter_value = StringInput("")  # graph input

all_elements_of_category = ElementsOfCategory(Category=categories)

# group: filter by parameter value
getParameterValueByName = Element.GetParameterValueByName(element=all_elements_of_category, parameterName=filter_by_parameter)
eq = getParameterValueByName == filter_parameter_value
filterByBoolMask = List.FilterByBoolMask(list=all_elements_of_category, mask=eq)

watch = Watch(filterByBoolMask.in)

# group: random angle
count = List.Count(list=filterByBoolMask.in)
randomList = Math.RandomList(amount=count)
code_block = CodeBlock(a=randomList) { a*360; }

setRotation = FamilyInstance.SetRotation(familyInstance=filterByBoolMask.in, degree=code_block)

# group: status
count_2 = List.Count(list=setRotation)
code_block_2 = CodeBlock(a=count_2) { a+" elementov bolo pootočených o náhodne zvolený uhol"; }
status = Watch(code_block_2)

návod = StringInput("Náhodne pootočí všetky Elementy vyhovujúce filtru, napr. stromy.")  # graph input
