# Dynamo graph pocetFormatov_po.dyn (Dynamo 2.3.0.5885)

# group: Gets Titleblocks
code_block = CodeBlock { "Title Blocks"; }
byName = Category.ByName(name=code_block)
all_elements_of_category = ElementsOfCategory(Category=byName)

py_clockwork_element_ownerview = Python(IN[0]=all_elements_of_category)
# ---------- py_clockwork_element_ownerview.python (16 lines) ----------
import clr
clr.AddReference('RevitAPI')
from Autodesk.Revit.DB import *

clr.AddReference("RevitNodes")
import Revit
clr.ImportExtensions(Revit.Elements)

def GetOwnerView(item):
	if hasattr(item, "OwnerViewId"): return item.Document.GetElement(item.OwnerViewId)
	else: return None

items = UnwrapElement(IN[0])

if isinstance(IN[0], list): OUT = [GetOwnerView(x) for x in items]
else: OUT = GetOwnerView(items)
# ----------------------------------------
code_block_2 = CodeBlock { "Pocet formatov num"; }
elementType = Element.ElementType(element=all_elements_of_category)
code_block_3 = CodeBlock { "Pocet formatov"; }
getParameterValueByName = Element.GetParameterValueByName(element=elementType, parameterName=code_block_3)
setParameterByName = Element.SetParameterByName(element=py_clockwork_element_ownerview, parameterName=code_block_2, value=getParameterValueByName)
návod = StringInput("""Každému Sheetu v projekte zapíše hodnotu "Pocet formatov" z Titleblocku, ktorý je vložený na Sheete do číselného Shared parametru "Pocet formatov num".

V revite je potom v Sheet liste možné spočítať všetky formáty časti alebo celej dokumentácie.""")  # graph input
