# Dynamo graph prierazyCircularDucts_p.dyn (Dynamo 2.0.1.5055)

# group: INPUT
select_wall = DSModelElementSelection()  # nothing selected; graph input
select_ducts = DSModelElementsSelection()  # nothing selected; graph input
o_koľko_má_byť_väčší_otvor_na = DoubleSlider(50, range=0..200 step 10)  # "o koľko má byť väčší otvor na každú stranu"; graph input
rozmer_otvorov_zaokrúliť_na = DoubleSlider(10, range=0..100 step 10)  # graph input
kód_profesie = StringInput("VZ")  # graph input

# group: Opening Family Type
code_block = CodeBlock { "Prieraz_KRUH_stena"; }
byName = FamilyType.ByName(name=code_block)
family_prierazu = FamilyTypes(index=32)

geometry = Element.Geometry(element=select_wall)
location = Custom[Element.Location+](element=select_ducts)  # Returns the location of an element as point, curve or curve loop, along with some booleans to help filtering the results. Unlike the OOTB Element.GetLocation node, it also retunrs sketch lines of sketch-based elements like floor slabs as well as the element's rotation property.
intersect = Geometry.Intersect(geometry=geometry, other=location.curves, lacing=CrossProduct)
flatten = List.Flatten(list=intersect)
endPoint = Curve.EndPoint(curve=flatten)
byPoints = Custom[Springs.HostedInstance.ByPoints](host=select_wall, type=byName, point=endPoint)  # Creates hosted family instances(doors/windows) at the specified points. You can feed either a single family type or a unique type for each instance.
code_block_2 = CodeBlock { "Priemer"; }
code_block_3 = CodeBlock(a=o_koľko_má_byť_väčší_otvor_na) { a*2; }

# group: Calculates opening width
code_block_4 = CodeBlock { "Width"; }
getParameterValueByName = Element.GetParameterValueByName(element=select_ducts, parameterName=code_block_4)
code_block_5 = CodeBlock(parameter=getParameterValueByName, offset=code_block_3) { parameter + offset; }
ceiling = Custom[Rounding.Ceiling+](dbl=code_block_5, precision=rozmer_otvorov_zaokrúliť_na)  # Rounds a number *up* to a specified precision

# group: set opening size
setParameterByName = Element.SetParameterByName(element=byPoints, parameterName=code_block_2, value=ceiling)

# group: lowering basepoint because of origin on bottom edge
X = Point.X(point=endPoint)
Y = Point.Y(point=endPoint)
Z = Point.Z(point=endPoint)
code_block_6 = CodeBlock(z=Z, height=code_block_4, rezerva=code_block_3) { z-height/2-rezerva; }
byCoordinates = Point.ByCoordinates(x=X, y=Y, z=code_block_6)

návod = StringInput("""Vo vybranej stene vytvorí automaticky prierazy pre vybrané VZT potrubia kruhového prierezu - Duct. V projekte musí byť naloadovaná family s názvom "Prieraz_KRUH_stena"  a pridaný Shared Parameter "Profesia".

Trasy profesií je potrebné dočasne nakopírovať priamo do projektu. Nestačí mať naloadovaný link.

Je potrebné mať nainštalované packages Clockwork a Springs.""")  # graph input
parameter_name = StringInput("Profesia")

# group: setter - profesia
setParameterByName_2 = Element.SetParameterByName(parameterName=parameter_name, value=kód_profesie)  # unwired: element
