# Dynamo graph prierazyPipes_p.dyn (Dynamo 2.3.0.5885)
# packages: Clockwork for Dynamo 2.x 2.1.2, spring nodes 203.1.0

# group: Opening Family Type
family_prierazu = FamilyTypes()  # nothing selected
code_block = CodeBlock { "Prieraz_KRUH_stena"; }
byName = FamilyType.ByName(name=code_block)

návod = StringInput("""Vo vybranej stene vytvorí automaticky prierazy pre vybrané potrubia v kategórii Pipes kruhového prierezu. V projekte musí byť naloadovaná family s názvom "Prieraz_KRUH_stena" a pridaný Shared Parameter "Profesia".

Trasy profesií je potrebné dočasne nakopírovať priamo do projektu. Nestačí mať naloadovaný link.

Je potrebné mať nainštalované packages Clockwork a Springs""")  # graph input

# group: INPUT
select_wall = DSModelElementSelection()  # nothing selected; graph input
select_pipes = DSModelElementsSelection()  # nothing selected; graph input
o_koľko_má_byť_väčší_otvor_na = DoubleSlider(50, range=0..200 step 10)  # "o koľko má byť väčší otvor na každú stranu"; graph input
rozmer_otvorov_zaokrúliť_na = DoubleSlider(10, range=0..100 step 10)  # graph input
kód_profesie = StringInput("ZT")  # graph input

geometry = Element.Geometry(element=select_wall)
location = Custom[Element.Location+](element=select_pipes)  # package Clockwork for Dynamo 2.x; Returns the location of an element as point, curve or curve loop, along with some booleans to help filtering the results. Unlike the OOTB Element.GetLocation node, it also retunrs sketch lines of sketch-based elements like floor slabs as well as the element's rotation property.
intersect = Geometry.Intersect(geometry=geometry, other=location.curves, lacing=CrossProduct)
flatten = List.Flatten(list=intersect)
endPoint = Curve.EndPoint(curve=flatten)
byPoints = Custom[Springs.HostedInstance.ByPoints](host=select_wall, type=byName, point=endPoint)  # package spring nodes; Creates hosted family instances(doors/windows) at the specified points. You can feed either a single family type or a unique type for each instance.
code_block_2 = CodeBlock(a=o_koľko_má_byť_väčší_otvor_na) { a*2; }

# group: Calculates opening size
code_block_3 = CodeBlock { "Outside Diameter"; }
getParameterValueByName = Element.GetParameterValueByName(element=select_pipes, parameterName=code_block_3)
code_block_4 = CodeBlock { "Insulation Thickness"; }
getParameterValueByName_2 = Element.GetParameterValueByName(element=select_pipes, parameterName=code_block_4)
code_block_5 = CodeBlock(diameter=getParameterValueByName, offset=code_block_2, insulation=getParameterValueByName_2) { diameter + offset + insulation; }
ceiling = Custom[Rounding.Ceiling+](dbl=code_block_5, precision=rozmer_otvorov_zaokrúliť_na)  # package Clockwork for Dynamo 2.x; Rounds a number *up* to a specified precision

# group: set opening size
code_block_6 = CodeBlock { "Priemer"; }
setParameterByName = Element.SetParameterByName(element=byPoints, parameterName=code_block_6, value=ceiling)

parameter_name = StringInput("Profesia")

# group: setter - profesia
setParameterByName_2 = Element.SetParameterByName(element=setParameterByName, parameterName=parameter_name, value=kód_profesie)
