# Dynamo graph revision cloud comments schedule ALL_p.dyn (Dynamo 2.3.0.5885)

code_block = CodeBlock { "Revision Clouds"; }
byName = Category.ByName(name=code_block)
all_elements_of_category = ElementsOfCategory(Category=byName)
code_block_2 = CodeBlock { "Comments"; }
getParameterValueByName = Element.GetParameterValueByName(element=all_elements_of_category, parameterName=code_block_2)
watch = Watch(getParameterValueByName)

# group: INPUT
# note: Vytvori zoznam vsetkych Revision Clouds s priradenym Comments vo forme tabulky, ktoru vyexportuje do formatu *.xls aj s ID daneho Revision Cloudu. V Revite potom Revision cloud najdeme pomocou Manage/Inquiry/Select by ID
file_path = Filename("C:\Users\davidv\Documents\rev.xlsx")  # graph input

code_block_3 = CodeBlock { "sheet"; 0; }
id = Element.Id(element=all_elements_of_category)
create = List.Create(item0=getParameterValueByName, item1=id)
transpose = List.Transpose(lists=create)
boolean = BoolSelector(true)
exportExcel = Data.ExportExcel(filePath=file_path, sheetName=code_block_3.out0, startRow=code_block_3.out1, startCol=code_block_3.out1, data=transpose, overWrite=boolean)
návod = StringInput("Vytvori zoznam vsetkych Revision Clouds s priradenym Comments vo forme tabulky, ktoru vyexportuje do formatu *.xls aj s ID daneho Revision Cloudu. V Revite potom Revision cloud najdeme pomocou Manage/Inquiry/Select by ID")  # graph input
