# Dynamo graph room and tag centre.dyn (Dynamo 1.3.2.2480)

levels = Levels()
all_elements_at_level = ElementsAtLevel(levels)
room_and_tag_location_centering = Custom[Room and Tag Location Centering](Rooms=all_elements_at_level@L1)  # Move room location point and its tag to its centroid. If centroid is located outside the room, location point stays at its origin coords.
