# Dynamo graph roomNumberIntoParameter.dyn (Dynamo 2.3.0.5885)
# packages: Rhythm 2019.12.4

návod = StringInput("všetkým elementom v miestnosiach zapíše do vybraného parametru Room Number miestnosti, v ktorej sa daný element nachádza.")  # graph input

# group: input
categories = Categories("OST_GenericModel")  # graph input
parameter_name_pre_zápis_room = StringInput("Comments")  # "Parameter Name pre zápis Room Number"; graph input

all_elements_of_category = ElementsOfCategory(Category=categories)
ʳʰʸᵗʰᵐ_familyinstances_room = Rhythm.Revit.Elements.FamilyInstances.Room(instance=all_elements_of_category)
code_block = CodeBlock { "Number"; }
getParameterValueByName = Element.GetParameterValueByName(element=ʳʰʸᵗʰᵐ_familyinstances_room, parameterName=code_block)
setParameterByName = Element.SetParameterByName(element=all_elements_of_category, parameterName=parameter_name_pre_zápis_room, value=getParameterValueByName)
count = List.Count(list=setParameterByName)
code_block_2 = CodeBlock(count=count) { "Room Number bola zapísaná do parametru " + count + " elementov."; }
status = Watch(code_block_2)  # graph output
