# Dynamo graph roomRenumberingSpline_filterByNameNotV2_p.dyn (Dynamo 2.12.1.8246)
# packages: cata_lyst 0.0.1

code_block = CodeBlock { "Rooms"; }
byName = Category.ByName(name=code_block)
all_elements_of_category = ElementsOfCategory(Category=byName)
filter_by_type_parameter_name = CodeBlock { "Name"; }

# group: INPUT
name_filter_not_1_miestnosti_s = StringInput("Kobka")  # "Name filter NOT - 1 miestnosti s týmto parametrom sa neprečíslujú"; graph input
name_filter_not_2_miestnosti_s = StringInput("Sklad garáže")  # "Name filter NOT - 2 miestnosti s týmto parametrom sa neprečíslujú"; graph input
select_spline = DSModelElementSelection()  # nothing selected; graph input
code_block_2 = CodeBlock { 1000; }
prefix = StringInput("P")  # graph input
number_of_level = DoubleInput(5)  # graph input
start_number = DoubleInput(1)  # graph input

# group: filter by parameter
getParameterValueByName = Element.GetParameterValueByName(element=all_elements_of_category, parameterName=filter_by_type_parameter_name)
eq = getParameterValueByName == name_filter_not_1_miestnosti_s
eq_2 = getParameterValueByName == name_filter_not_2_miestnosti_s
xor = Math.Xor(bool=eq, otherBool=eq_2)
filterByBoolMask = List.FilterByBoolMask(list=all_elements_of_category, mask=xor)

# note: chyba v tomto node, znamena ze ciara nie je nakreslena ako MODEL LINE
curve = CurveElement.Curve(curveElement=select_spline)
# note: chyba v tomto node znamena ze ciara je prilis dlha
pointsAtChordLengthFromPoint = Curve.PointsAtChordLengthFromPoint(curve=curve, chordLength=code_block_2)
splitByPoints = Curve.SplitByPoints(curve=curve, points=pointsAtChordLengthFromPoint)
endPoint = Curve.EndPoint(curve=splitByPoints)
isInsideRoom = Room.IsInsideRoom(room=filterByBoolMask.out, point=endPoint, lacing=CrossProduct)
transpose = List.Transpose(lists=isInsideRoom)
count = List.Count(list=endPoint)
code_block_3 = CodeBlock(a=count) { 1..a; }
sortByKey = List.SortByKey(list=transpose, keys=code_block_3)
filterByBoolMask_2 = List.FilterByBoolMask(list=filterByBoolMask.out, mask=sortByKey.sortedList@L2)
flatten = List.Flatten(list=filterByBoolMask_2.in)
uniqueItems = List.UniqueItems(list=flatten)
watch = Watch(uniqueItems)
string = StringInput("Number")
code_block_4 = CodeBlock { "."; }
count_2 = List.Count(list=watch)
number = DoubleInput(1)
sequence = Sequence(start=start_number, amount=count_2, step=number, lacing=Longest)

# group: 0 navyse pri dvojcifernych cislach
code_block_5 = CodeBlock { 100; 0; ""; }
lt = sequence < code_block_5.out0
if_ = If(test=lt, true=code_block_5.out1, false=code_block_5.out2)

# group: 0 navyse pri jednocifernych cislach
code_block_6 = CodeBlock { 10; 0; ""; }
lt_2 = sequence < code_block_6.out0
if_2 = If(test=lt_2, true=code_block_6.out1, false=code_block_6.out2)

string_from_object = FromObject(obj=sequence)
code_block_7 = CodeBlock(x=prefix, a=number_of_level, b=code_block_4, ba=if_, c=if_2, d=string_from_object) { x+a+b+ba+c+d; }
setParameterByName = Element.SetParameterByName(element=watch, parameterName=string, value=code_block_7)
count_3 = List.Count(list=setParameterByName)
počet_prečíslovaných_miestností = Watch(count_3)
návod = StringInput("""Pre bežné miestnosti
Format precislovania = pl.mmm
p=prefix, l=level, m=cislo miestnosti
napr. = P-2.056

Precisluje miestnosti podla nakreslenej ciary.
	Najprv je potrebne nakreslit ciaru (najlepsie spline), ktora pretina miestnosti ktore chceme precislovat. Ciary je dobre robit v samostatnej Subcategory napr. "Renumbering rooms" aby sa dali lahko vsetky naraz vypnut/zapnut pre nasledne opatovne precislovanie. Ciara musi byt kreslena ako Model Line alebo konvertovana z Detail Line.
	Model Line musi byt nakreslena vo Workplane, ktora pretina precislovane miestnosti, cize typicky v rovine podlahy. Pri velmi dlhej ciare sa moze vyskytnut chyba, vtedy rozdelte ciaru na viacere elementy.
	Prikaz moze pracovat dlhsie, nepustajte ho v automatickom mode, ale len v manualnom.""")  # graph input
code_block_8 = CodeBlock { "RoomRenumberingSpline_filterByNameNotV2"; }
usageLog = Custom[usageLog](scriptName=code_block_8)  # package cata_lyst; node logs every run of the script in which is used to the hardcoded server location
