# Dynamo graph sheetCreateExcel.dyn "sheetCreateExcel_sk" (Dynamo 2.3.0.5885)

# group: INPUT
file_path_pre_excelovsku_tabulku = Filename("alpha_versions\sheets\v4\sheetlist_KP_BD D01-D15.xlsx")  # graph input
vyber_title_block = FamilyTypes("Sheet-Kniha-bytov_KONC. PRVKY_RP:Sheet-Kniha-bytov_KONC. PRVKY_RP")  # graph input

fromPath = FileObject(path=file_path_pre_excelovsku_tabulku)  # "File.FromPath"
string = StringInput("Sheet")
boolean = BoolSelector(false)
importExcel = Data.ImportExcel(file=fromPath, sheetName=string, readAsStrings=boolean)
watch = Watch(importExcel)
návod = StringInput("""Vytvorí Sheety s číslami a názvami výkresov podľa excelovskej tabuľky.
Na každý Sheet pridá Floor Plan s názvom podľa 3. stĺpca.

V projekte nemôžu byť 2 rovnako nazvané Floor Plany ak je jeden z nich chceme automaticky umiestňovať na Sheet.

Formát XLS súboru:
1. stĺpec - Sheet Number
2. stĺpec - Sheet Name
3. Stĺpec - View Name""")  # graph input
transpose = List.Transpose(lists=importExcel)
number = DoubleInput(1)
getItemAtIndex = List.GetItemAtIndex(list=transpose, index=number)
watch_2 = Watch(getItemAtIndex)
number_2 = DoubleInput(0)
getItemAtIndex_2 = List.GetItemAtIndex(list=transpose, index=number_2)
watch_3 = Watch(getItemAtIndex_2)
categories = Categories("OST_Views")
all_elements_of_category = ElementsOfCategory(Category=categories)

# group: Filter - just FloorPlans
type = Object.Type(obj=all_elements_of_category)
code_block = CodeBlock { "Revit.Elements.Views.FloorPlanView"; }
eq = type == code_block
filterByBoolMask = List.FilterByBoolMask(list=all_elements_of_category, mask=eq)

code_block_2 = CodeBlock { "View Name"; }
getParameterValueByName = Element.GetParameterValueByName(element=filterByBoolMask.in, parameterName=code_block_2)
number_3 = DoubleInput(2)
getItemAtIndex_3 = List.GetItemAtIndex(list=transpose, index=number_3)
watch_4 = Watch(getItemAtIndex_3)

# group: removing nulls
code_block_3 = CodeBlock { 0; }
string_from_object = FromObject(obj=watch_4)
code_block_4 = CodeBlock { "null"; }
allIndicesOf = List.AllIndicesOf(list=string_from_object, item=code_block_4)
firstItem = List.FirstItem(list=allIndicesOf)
slice = List.Slice(list=watch_4, start=code_block_3, end=firstItem)

allIndicesOf_2 = List.AllIndicesOf(list=getParameterValueByName, item=slice)
flatten = List.Flatten(list=allIndicesOf_2)
getItemAtIndex_4 = List.GetItemAtIndex(list=filterByBoolMask.in, index=flatten)
byNameNumberTitleBlockAndView = Sheet.ByNameNumberTitleBlockAndView(sheetName=watch_2, sheetNumber=watch_3, titleBlockFamilyType=vyber_title_block, view=getItemAtIndex_4)
count = List.Count(list=byNameNumberTitleBlockAndView)
code_block_5 = CodeBlock(count=count) { "Bolo vytvorenych " + count + " Sheetov."; }
status = Watch(code_block_5)  # graph output
sheets = Watch(byNameNumberTitleBlockAndView)  # graph output
