# Dynamo graph sheetCreateExcelLegend.dyn (Dynamo 1.3.4.6666)

# group: INPUT
file_path_pre_excelovsku_tabulku = Filename(".\sheetlist_KP_BD D01-D15.xlsx")
vyber_title_block = FamilyTypes("Sheet-Kniha-bytov_KONC. PRVKY_RP:Sheet-Kniha-bytov_KONC. PRVKY_RP")

fromPath = FileObject(file_path_pre_excelovsku_tabulku)  # "File.FromPath"
string = StringInput("Sheet")
boolean = BoolSelector(false)
readFromFile = Excel.ReadFromFile(file=fromPath, sheetName=string, readAsStrings=boolean)
watch = Watch(readFromFile)
návod = StringInput("""Vytvorí Sheety s číslami a názvami výkresov podľa excelovskej tabuľky.
Na každý Sheet pridá Floor Plan s názvom podľa 3. stĺpca.

V projekte nemôžu byť 2 rovnako nazvané Floor Plany ak je jeden z nich chceme automaticky umiestňovať na Sheet.

Formát XLS súboru:
1. stĺpec - Sheet Number
2. stĺpec - Sheet Name
3. Stĺpec - View Name""")
categories = Categories("Views")
all_elements_of_category = ElementsOfCategory(categories)

# group: Filter - just FloorPlans
type = Object.Type(all_elements_of_category)
code_block = CodeBlock { "Revit.Elements.Views.FloorPlanView"; }
eq = type == code_block
filterByBoolMask = List.FilterByBoolMask(list=all_elements_of_category, mask=eq)

code_block_2 = CodeBlock { "View Name"; }
getParameterValueByName = Element.GetParameterValueByName(element=filterByBoolMask.in, parameterName=code_block_2)
transpose = List.Transpose(readFromFile)
number = DoubleInput(2)
getItemAtIndex = List.GetItemAtIndex(list=transpose, index=number)
watch_2 = Watch(getItemAtIndex)

# group: removing nulls
code_block_3 = CodeBlock { 0; }
string_from_object = FromObject(watch_2)
code_block_4 = CodeBlock { "null"; }
allIndicesOf = List.AllIndicesOf(list=string_from_object, item=code_block_4)
firstItem = List.FirstItem(allIndicesOf)
slice = List.Slice(watch_2, code_block_3, firstItem)

allIndicesOf_2 = List.AllIndicesOf(list=getParameterValueByName, item=slice)
flatten = Flatten(allIndicesOf_2)
getItemAtIndex_2 = List.GetItemAtIndex(list=filterByBoolMask.in, index=flatten)
number_2 = DoubleInput(1)
getItemAtIndex_3 = List.GetItemAtIndex(list=transpose, index=number_2)
watch_3 = Watch(getItemAtIndex_3)
number_3 = DoubleInput(0)
getItemAtIndex_4 = List.GetItemAtIndex(list=transpose, index=number_3)
watch_4 = Watch(getItemAtIndex_4)
views = Views("Legenda materiálov")
byNameNumberTitleBlockAndView = Sheet.ByNameNumberTitleBlockAndView(sheetName=watch_3, sheetNumber=watch_4, titleBlockFamilyType=vyber_title_block, view=views)
number_slider = DoubleSlider(0, range=0..100 step 0.1)
number_slider_2 = DoubleSlider(0, range=0..100 step 0.1)
byCoordinates = Point.ByCoordinates(x=number_slider, y=number_slider_2)
python_script = Python(IN[0]=getItemAtIndex_2, IN[1]=byNameNumberTitleBlockAndView, IN[2]=byCoordinates)
# ---------- python_script.python (40 lines) ----------
import clr
# import Document Manager
clr.AddReference("RevitServices")
import RevitServices 
from RevitServices.Persistence import DocumentManager
from RevitServices.Transactions import TransactionManager
doc = DocumentManager.Instance.CurrentDBDocument
uidoc = DocumentManager.Instance.CurrentUIDocument
clr.AddReference("RevitNodes")
import Revit
clr.ImportExtensions(Revit.Elements)
clr.ImportExtensions(Revit.GeometryConversion)
clr.AddReference("RevitAPI")
from Autodesk.Revit.DB import *

dataEnteringNode = IN

legend = UnwrapElement(IN[0])
sheets = IN[1]
loc = XYZ(IN[2].X, IN[2].Y, IN[2].Z)
viewports = []
failed = []

for vs in sheets:
	sheet = UnwrapElement(vs)
	canAddToSht = Viewport.CanAddViewToSheet(doc, sheet.Id, legend.Id)
	if canAddToSht:
		try:		
			TransactionManager.Instance.EnsureInTransaction(doc)	
			viewport = Viewport.Create(doc, sheet.Id, legend.Id, loc)	
			TransactionManager.Instance.TransactionTaskDone()
			viewports.Add([viewport,sheet])
		except:
			failed.Add(["Failed",sheet])
	else:
		failed.Add(["Failed",sheet])
		
OUT = [viewports, failed]
	
#For more information refer to RBG Wiki or email me (ctrl + click link): daniel.woodcock@robertbird.com
# ----------------------------------------
