# Dynamo graph sheets upper case.dyn (Dynamo 2.3.0.5885)

code_block = CodeBlock { "Sheets"; }
byName = Category.ByName(name=code_block)
all_elements_of_category = ElementsOfCategory(Category=byName)

# group: INPUT
# note: Zmeni velkost pisma na VELKE v nazve Sheetov.
# Sheety vyfiltruje podla zadaneho parametra. Ak je potrebne zmenit velkost pisma vo vsetkych Sheetoch, INPUT node "Search for" zostane nevyplneny
filter_by_parameter = CodeBlock { "Approved By"; }
search_for = CodeBlock { "Výpis"; }

getParameterValueByName = Element.GetParameterValueByName(element=all_elements_of_category, parameterName=filter_by_parameter)
contains = String.Contains(str=getParameterValueByName, searchFor=search_for)
filterByBoolMask = List.FilterByBoolMask(list=all_elements_of_category, mask=contains)
code_block_2 = CodeBlock { "Sheet Name"; }
getParameterValueByName_2 = Element.GetParameterValueByName(element=filterByBoolMask.in, parameterName=code_block_2)
toUpper = String.ToUpper(str=getParameterValueByName_2)
setParameterByName = Element.SetParameterByName(element=filterByBoolMask.in, parameterName=code_block_2, value=toUpper)
