# Dynamo graph spline2arcs_p.dyn (Dynamo 1.3.1.1736)

návod = StringInput("Lines nakreslené cez krivky - Splines prekreslí vyskladaním z oblúkov Arcs")

# group: INPUT
select_model_line = DSModelElementSelection()  # 1 picked in the model
počet_oblúkov = DoubleSlider(6, range=1..25 step 1)

curve = CurveElement.Curve(select_model_line)
počet_segmentov = CodeBlock(a=počet_oblúkov) { 2*a; }
code_block = CodeBlock(a=počet_segmentov) { a-1; }
pointsAtEqualChordLength = Curve.PointsAtEqualChordLength(curve, code_block)
splitByPoints = Curve.SplitByPoints(curve=curve, points=pointsAtEqualChordLength)
startPoint = Curve.StartPoint(splitByPoints)
count = Count(startPoint)
code_block_2 = CodeBlock(a=count) { 0; a; 1; }
triplets_py = Python(IN[0]=code_block_2.out0, IN[1]=code_block_2.a, IN[2]=code_block_2.out2, IN[3]=startPoint)
# ---------- triplets_py.python (24 lines) ----------
import clr
clr.AddReference('ProtoGeometry')
from Autodesk.DesignScript.Geometry import *
#The inputs to this node will be stored as a list in the IN variables.
start = IN[0]
end = IN[1]
step = IN[2]
points = list()
points = IN[3]

##variables
count = len(points)

triplets = list(range(start,end,2))
result = list()
for i in triplets:
    result.append(points[i:i+3])
print result

#Assign your output to the OUT variable.
try:
	OUT = result
except:
	OUT = "something went wrong"
# ----------------------------------------
watch = Watch(triplets_py)
endPoint = Curve.EndPoint(splitByPoints)
just_last_item_py = Python(IN[0]=endPoint)
# ---------- just_last_item_py.python (10 lines) ----------
import clr
clr.AddReference('ProtoGeometry')
from Autodesk.DesignScript.Geometry import *
#The inputs to this node will be stored as a list in the IN variables.
items = IN[0]

result = items[-1]

#Assign your output to the OUT variable.
OUT = result
# ----------------------------------------
just_last_item_py_2 = Python(IN[0]=triplets_py, IN[1]=just_last_item_py)
# ---------- just_last_item_py_2.python (13 lines) ----------
import clr
clr.AddReference('ProtoGeometry')
from Autodesk.DesignScript.Geometry import *
#The inputs to this node will be stored as a list in the IN variables.
items = IN[0]
LastPoint = IN[1]


#result = items.append(LastPoint)
items[-1].append(LastPoint)

#Assign your output to the OUT variable.
OUT = items
# ----------------------------------------
watch_2 = Watch(just_last_item_py_2)
first_items_py = Python(IN[0]=just_last_item_py_2)
# ---------- first_items_py.python (10 lines) ----------
import clr
clr.AddReference('ProtoGeometry')
from Autodesk.DesignScript.Geometry import *
#The inputs to this node will be stored as a list in the IN variables.
points = IN[0]

result = [item[0] for item in points]

#Assign your output to the OUT variable.
OUT = result
# ----------------------------------------
second_items_py = Python(IN[0]=just_last_item_py_2)
# ---------- second_items_py.python (10 lines) ----------
import clr
clr.AddReference('ProtoGeometry')
from Autodesk.DesignScript.Geometry import *
#The inputs to this node will be stored as a list in the IN variables.
points = IN[0]

result = [item[1] for item in points]

#Assign your output to the OUT variable.
OUT = result
# ----------------------------------------
third_items_py = Python(IN[0]=just_last_item_py_2)
# ---------- third_items_py.python (10 lines) ----------
import clr
clr.AddReference('ProtoGeometry')
from Autodesk.DesignScript.Geometry import *
#The inputs to this node will be stored as a list in the IN variables.
points = IN[0]

result = [item[2] for item in points]

#Assign your output to the OUT variable.
OUT = result
# ----------------------------------------
byThreePoints = Arc.ByThreePoints(firstPoint=first_items_py, secondPoint=second_items_py, thirdPoint=third_items_py)
byCurve = ModelCurve.ByCurve(byThreePoints)
id = Element.Id(byCurve)
id_of_created_arcs = Watch(id)
