# Dynamo graph spline2segmentedWalls_p.dyn (Dynamo 2.3.0.5885)

návod = StringInput("vytvorí nasegmentované steny alebo Curtain Walls podľa krivky s voliteľnou dĺžkou segmentu")  # graph input

# group: INPUT
select_model_line = DSModelElementSelection()  # 1 picked in the model; graph input
segment_length = DoubleSlider(900, range=200..8000 step 50)  # graph input
levels_start = Levels("lamely pata")  # graph input
levels_end = Levels("Level 1")  # graph input
wall_types = WallTypes("oporne mury 300mm")  # graph input

curve = CurveElement.Curve(curveElement=select_model_line)
pointsAtChordLengthFromPoint = Curve.PointsAtChordLengthFromPoint(curve=curve, chordLength=segment_length)
splitByPoints = Curve.SplitByPoints(curve=curve, points=pointsAtChordLengthFromPoint)
watch = Watch(splitByPoints)
startPoint = Curve.StartPoint(curve=splitByPoints)
endPoint = Curve.EndPoint(curve=splitByPoints)
byStartPointEndPoint = Line.ByStartPointEndPoint(startPoint=startPoint, endPoint=endPoint)
byCurveAndLevels = Wall.ByCurveAndLevels(c=byStartPointEndPoint, startLevel=levels_start, endLevel=levels_end, wallType=wall_types)
