# Dynamo graph spline2segments_p.dyn (Dynamo 2.3.0.5885)

návod = StringInput("vytvorí nasegmentované steny alebo Curtain Walls podľa krivky s voliteľnou dĺžkou segmentu")  # graph input

# group: INPUT
select_model_line = DSModelElementSelection()  # nothing selected; graph input
segment_length = DoubleSlider(7000, range=200..8000 step 50)  # graph input

curve = CurveElement.Curve(curveElement=select_model_line)
pointsAtChordLengthFromPoint = Curve.PointsAtChordLengthFromPoint(curve=curve, chordLength=segment_length)
splitByPoints = Curve.SplitByPoints(curve=curve, points=pointsAtChordLengthFromPoint)
watch = Watch(splitByPoints)
startPoint = Curve.StartPoint(curve=splitByPoints)
endPoint = Curve.EndPoint(curve=splitByPoints)
byStartPointEndPoint = Line.ByStartPointEndPoint(startPoint=startPoint, endPoint=endPoint)
byCurve = ModelCurve.ByCurve(curve=byStartPointEndPoint)
vytvorené_segmenty = Watch(byCurve)
