# Dynamo graph splineArray_p.dyn "splineArray" (Dynamo 2.0.1.5055)

# group: INPUT
vyber_line = DSModelElementSelection()  # 1 picked in the model; graph input
rozostup_elementov = DoubleSlider(1600, range=50..2000 step 50)  # graph input
element = FamilyTypes(index=911)  # graph input

curve = CurveElement.Curve(curveElement=vyber_line)
pointsAtChordLengthFromPoint = Curve.PointsAtChordLengthFromPoint(curve=curve, chordLength=rozostup_elementov)
splitByPoints = Curve.SplitByPoints(curve=curve, points=pointsAtChordLengthFromPoint)
endPoint = Curve.EndPoint(curve=splitByPoints)
startPoint = Curve.StartPoint(curve=splitByPoints)
byPoint = FamilyInstance.ByPoint(familyType=element, point=startPoint)
návod = StringInput("Rozmiestni elementy na krivku v rovnomernom nastavitelnom rozostupe")  # graph input
