# Dynamo graph subregion2floorOnTopo_p.dyn (Dynamo 1.3.2.2480)

# group: INPUT
select_topography = DSModelElementSelection()
select_element = DSModelElementSelection()
floor_type = FloorTypes("chodník - okolie")
level = Levels("1.NP")
offset_floor_od_topography = DoubleSlider(45, range=0..100 step 5)

mesh = Topography.Mesh(select_topography)
toPolySurface = Custom[Springs.Mesh.ToPolySurface](mesh=mesh)  # Converts a Dynamo mesh to a polysurface. Uses multithreading - optimized for 4 cores.

# group: floor creation
boolean = BoolSelector(true)
elementSketch = Custom[Springs.Collector.ElementSketch](element=select_element, fetchModelCurves=boolean)  # Get the actual sketch lines of a sketch based element (floor, ceiling, modified wall, etc.) . You can optionally fetch the matching model curves, however this might prove comptationally heavy on larger data sets.
flatten = Flatten(elementSketch.model_curves)
curve = CurveElement.Curve(flatten)
byOutlineTypeAndLevel = Floor.ByOutlineTypeAndLevel(outlineCurves=curve, floorType=floor_type, level=level)
code_block = CodeBlock { "Height Offset From Level"; 8000; }
setParameterByName = Element.SetParameterByName(element=byOutlineTypeAndLevel, parameterName=code_block.out0, value=code_block.out1)

# group: sketch lines collector
boolean_2 = BoolSelector(true)
elementSketch_2 = Custom[Springs.Collector.ElementSketch](element=setParameterByName, fetchModelCurves=boolean_2)
curve_2 = CurveElement.Curve(elementSketch_2.model_curves)
endPoint = Curve.EndPoint(curve_2)
startPoint = Curve.StartPoint(curve_2)
create = List.Create(endPoint, startPoint)
flatten_2 = Flatten(create)
uniqueItems = List.UniqueItems(flatten_2)

# group: get max height of topography
faceVertices = Custom[Mesh.FaceVertices](mesh=mesh)  # Gets the vertices of each face of a given mesh
X = Point.X(faceVertices)

flatten_3 = Flatten(X)

# group (continued): get max height of topography
maximumItem = List.MaximumItem(flatten_3)

# group: vertical lines to intersect
X_2 = Point.X(uniqueItems)
Y = Point.Y(uniqueItems)
code_block_2 = CodeBlock(maxheight=maximumItem) { maxheight; -1*maxheight; }
byCoordinates = Point.ByCoordinates(x=X_2, y=Y, z=code_block_2.maxheight)
byCoordinates_2 = Point.ByCoordinates(x=X_2, y=Y, z=code_block_2.out1)
byStartPointEndPoint = Line.ByStartPointEndPoint(startPoint=byCoordinates, endPoint=byCoordinates_2)

flatten_4 = Flatten(byStartPointEndPoint)
intersect = Geometry.Intersect(geometry=toPolySurface, other=flatten_4)
flatten_5 = Flatten(intersect)
clear_list = Custom[Clear List](Input=flatten_5)  # This node will remove all Null and Empty Lists from any list.
points = Topography.Points(select_topography)
join = List.Join(clear_list, points)

# group: floor Z-axis elevation
X_3 = Point.X(join)
Y_2 = Point.Y(join)
Z = Point.Z(join)
code_block_3 = CodeBlock(a=Z, offset=offset_floor_od_topography) { a+offset; }
byCoordinates_3 = Point.ByCoordinates(x=X_3, y=Y_2, z=code_block_3)

slabShapeByPoints = Custom[Floor.SlabShapeByPoints](points=byCoordinates_3, floor=setParameterByName)  # Transform a slab shape based on a list of Points
points_of_floor_sketch = Watch(clear_list)
návod = StringInput("Skonvertuje Subregion na Floor, ktorý výškovo upraví podľa Topography")
