# Dynamo graph text change case_p.dyn (Dynamo 1.3.3.4111)

návod = StringInput("Zmeni VELKE PISMENA na male pismena v textovom poli a naopak.\n Zvlast sa ovlada prve pismeno a zvlast nasledujuce pismena v textovom poli\n Pre fungovanie treba doinstalovat Package \"Clockwork\"")

# group: INPUT
select_text_note = DSModelElementSelection()
prve_pismeno_velke = BoolSelector(true)
ostatne_pismena_velke = BoolSelector(true)

text = TextNote.Text(select_text_note)

# group: prve pismeno
code_block = CodeBlock { 0; 1; }
substring = String.Substring(str=text, startIndex=code_block.out0, length=code_block.out1)
changeCase = String.ChangeCase(substring, prve_pismeno_velke)

# group: ostatne pismena
length = String.Length(text)
code_block_2 = CodeBlock(a=length) { 1; a-1; }
substring_2 = String.Substring(str=text, startIndex=code_block_2.out0, length=code_block_2.out1)
changeCase_2 = String.ChangeCase(substring_2, ostatne_pismena_velke)

concat = String.Concat(changeCase, changeCase_2)
setText = TextNote.SetText(select_text_note, concat)
