# Dynamo graph topographyMeterAdHoc_p.dyn "topographyMeterAdHoc" (Dynamo 2.0.1.5055)

select_site_element = DSModelElementSelection()  # nothing selected; graph input
location = FamilyInstance.Location(familyInstance=select_site_element)
select_floor = DSModelElementSelection()  # nothing selected; graph input
geometry = Element.Geometry(element=select_floor)
flatten = List.Flatten(list=geometry)

# group: union for floors overlaping in floorplan
byUnion = Solid.ByUnion(solids=flatten)

X = Point.X(point=location)
Y = Point.Y(point=location)
Z = Point.Z(point=location)

# group: lines from planting
code_block = CodeBlock(a=Z) { a+2000; }
byCoordinates = Point.ByCoordinates(x=X, y=Y, z=code_block)
code_block_2 = CodeBlock { -2000; }
byCoordinates_2 = Point.ByCoordinates(x=X, y=Y, z=code_block_2)
byStartPointEndPoint = Line.ByStartPointEndPoint(startPoint=byCoordinates, endPoint=byCoordinates_2)

intersect = Geometry.Intersect(geometry=byUnion, other=byStartPointEndPoint, lacing=Longest)
startPoint = Curve.StartPoint(curve=intersect)

# group: height lines
byStartPointEndPoint_2 = Line.ByStartPointEndPoint(startPoint=location, endPoint=startPoint)

Z_2 = Point.Z(point=startPoint)
code_block_3 = CodeBlock(b=Z, a=Z_2) { b-a; }

# group: minimum for multiple intersections
minimumItem = List.MinimumItem(list=code_block_3)

round = Math.Round(number=minimumItem)
code_block_4 = CodeBlock(a=round) { a+" m"; }
hrubka_substratu = Watch(code_block_4)  # graph output
návod = StringInput("Odmeria hrúbku substrátu medzi Site elementom hostovaným na Topography a oznacenym Floorom")  # graph input
