# Dynamo graph treeCheckerSandbox.dyn (Dynamo 2.0.1.5055)

categories = Categories(index=351)
all_elements_of_category = ElementsOfCategory(Category=categories)

# group: INPUT
cast_a_b_c = StringInput("CO2")

filter_planting_by_parameter = CodeBlock(A=cast_a_b_c) { "SO"+A+"002"; }

# group: Filter
code_block = CodeBlock { "SO-stavebny objekt"; }
getParameterValueByName = Element.GetParameterValueByName(element=all_elements_of_category, parameterName=code_block)
eq = getParameterValueByName == filter_planting_by_parameter
filterByBoolMask = List.FilterByBoolMask(list=all_elements_of_category, mask=eq)

code_block_2 = CodeBlock { "hlbka substratu"; }
location = FamilyInstance.Location(familyInstance=filterByBoolMask.in)
Z = Point.Z(point=location)
categories_2 = Categories(index=206)
all_elements_of_category_2 = ElementsOfCategory(Category=categories_2)
filter_floors_by_typ_strechy = CodeBlock(A=cast_a_b_c) { "zelena strecha "+A; }

# group: floor filter
code_block_3 = CodeBlock { "typ strechy"; }
getParameterValueByName_2 = Element.GetParameterValueByName(element=all_elements_of_category_2, parameterName=code_block_3)
eq_2 = getParameterValueByName_2 == filter_floors_by_typ_strechy
filterByBoolMask_2 = List.FilterByBoolMask(list=all_elements_of_category_2, mask=eq_2)

geometry = Element.Geometry(element=filterByBoolMask_2.in)
flatten = List.Flatten(list=geometry)

# group: union for floors overlaping in floorplan
byUnion = Solid.ByUnion(solids=flatten)

X = Point.X(point=location)
Y = Point.Y(point=location)

# group: lines from planting
code_block_4 = CodeBlock(a=Z) { a+2000; }
byCoordinates = Point.ByCoordinates(x=X, y=Y, z=code_block_4)
code_block_5 = CodeBlock { -2000; }
byCoordinates_2 = Point.ByCoordinates(x=X, y=Y, z=code_block_5)
byStartPointEndPoint = Line.ByStartPointEndPoint(startPoint=byCoordinates, endPoint=byCoordinates_2)

intersect = Geometry.Intersect(geometry=byUnion, other=byStartPointEndPoint, lacing=Longest)
startPoint = Curve.StartPoint(curve=intersect)
Z_2 = Point.Z(point=startPoint)
code_block_6 = CodeBlock(b=Z, a=Z_2) { b-a; }

# group: minimum for multiple intersections
minimumItem = List.MinimumItem(list=code_block_6)

# group: round
code_block_7 = CodeBlock { 20; }
code_block_8 = CodeBlock(a=minimumItem, b=code_block_7) { a/b; }
round = Math.Round(number=code_block_8)
code_block_9 = CodeBlock(a=round, b=code_block_7) { a*b; }

# group: null to "na terene"
string_from_object = FromObject(obj=code_block_9)
code_block_10 = CodeBlock { "null"; "na rastlom teréne"; }
replace = String.Replace(str=string_from_object, searchFor=code_block_10.out0, replaceWith=code_block_10.out1)

setParameterByName = Element.SetParameterByName(element=filterByBoolMask.in, parameterName=code_block_2, value=replace)

# group: height lines
byStartPointEndPoint_2 = Line.ByStartPointEndPoint(startPoint=location, endPoint=startPoint)

návod = StringInput("""Zvislú vzdialenosť od najbližieho Flooru zapíše do textového shared parametru "hrubka substratu". 

Floors musia mať priradený parameter Typ strechy vyhovujúci filtru.

Vhodné na kontrolu dostatočnej hrúbky substrátu pod stromami, ktorá sa dá vyhodnotiť v tabuľke.""")
