# Dynamo graph window_flip_checker_p.dyn (Dynamo 1.3.2.2480)

# group: INPUT
categories = Categories("Windows")
select_phase = RevitPhases()
parameter_name = StringInput("Comments")

all_elements_of_category = ElementsOfCategory(categories)
door_set_handing = Custom[Door Set Handing](Door_s=all_elements_of_category, Phase=select_phase)  # Determines door set handing (whether its a left or right handed door). Input takes doors, and output will split them into two lists (right and left).
code_block = CodeBlock(a=parameter_name) { a; "no"; "reversed"; }
setParameterByName = Element.SetParameterByName(element=door_set_handing.Right_Handed_Reversed, parameterName=code_block.a, value=code_block.out1)
setParameterByName_2 = Element.SetParameterByName(element=door_set_handing.Left_Handed_Reversed, parameterName=code_block.a, value=code_block.out2)
návod = StringInput("Vsetkym oknam v projekte zapise do parametru urcenom v \"Parameter Name\" informaciu o tom ci bolo dane okno flipovane alebo mirrorovane. Okna je mozne filtrovat podla fazy.\n \n\"no\" resp. \"reversed\"\n\nJe potrebne doinstalovat Package \"Achi-lab\"")
setParameterByName_3 = Element.SetParameterByName(element=door_set_handing.Right_Handed, parameterName=code_block.a, value=code_block.out2)
setParameterByName_4 = Element.SetParameterByName(element=door_set_handing.Left_Handed, parameterName=code_block.a, value=code_block.out1)
