# Dynamo graph template.dyn (Dynamo 2.3.1.11775)
# packages: cata_lyst 0.0.1

# group: INPUT
# note: Place inputs for Dynamo Player

# group: Filter
# note: filtering elements

# group: Error handling
# note: Treating errors as hints to user what to do to avoid the error

návod = StringInput("""Návod, ktorý uvidí používateľ v Dynamo Playeri.

Je potrebné mať nainštalované packages...""")  # graph input

# group: OUTPUT
# note: Place output for Dynamo Player
OUTPUT = Watch()  # graph output; unwired: arg0

# note: python FilterElementCollector
py_filterelementcollector = Python()
# ---------- py_filterelementcollector.python (24 lines) ----------
# Load the Python Standard and DesignScript Libraries
import sys
import clr
clr.AddReference('ProtoGeometry')
from Autodesk.DesignScript.Geometry import *

clr.AddReference("RevitServices")
clr.AddReference("RevitAPI")
import RevitServices
from RevitServices.Persistence import DocumentManager
from Autodesk.Revit import DB

doc = DocumentManager.Instance.CurrentDBDocument
uiapp = DocumentManager.Instance.CurrentUIApplication
app = uiapp.Application

rooms = DB.FilteredElementCollector(doc).OfCategory(DB.BuiltInCategory.OST_Rooms).WhereElementIsNotElementType().ToElements()
areas = []
for room in rooms:
	area = room.LookupParameter("Area").AsDouble()
	areas.append(area*0.3048*0.3048)

# Assign your output to the OUT variable.
OUT = areas
# ----------------------------------------
# note: Logovanie pre analytiku
# uprav nazov skriptu
code_block = CodeBlock { "novy nazov skriptu"; }
usageLog = Custom[usageLog](scriptName=code_block)  # package cata_lyst; node logs every run of the script in which is used to the hardcoded server location
